# Requirement set FAA_Firefighting_Amphibious_Requirements (R2024a)

Attributes:
- Category: Imported from Excel:Category
- Part: Imported from Excel:Part
- Regulation: Imported from Excel:Regulation
- Source_URL: Imported from Excel:Source_URL
- Status: Imported from Excel:Status
- Verification_Method: Imported from Excel:Verification_Method

## 1 [FAA_Firefighting_Amphibious_Requirements!FAA_Requirements] References to FAA_Firefighting_Amphibious_Requirements.xlsx (FAA_Requirements) (Container)
Read-only references to Microsoft Excel document.

### 1.1 [FAA-21-001] Restricted Category Type Certificate – Special Purpose
Applicant must obtain a Restricted Category Type Certificate under 14 CFR §21.25 for aerial dispensing of firefighting materials (forest and wildlife conservation). No feature or characteristic may make the aircraft unsafe when operated under limitations prescribed for its intended use.
Category: Certification
Part: Part 21
Regulation: Establishes the legal certification pathway for the firefighting mission.
Source_URL: https://www.ecfr.gov/current/title-14/chapter-I/subchapter-C/part-21/subpart-B/section-21.25
Status: Open
Verification_Method: Analysis / Document Review

### 1.2 [FAA-21-002] Special Purpose Operation – Aerial Firefighting
The restricted category certificate must specifically list aerial dispensing of firefighting materials under §21.25(b)(2)(i) (forest and wildlife conservation).
Category: Certification
Part: Part 21
Regulation: Defines the approved mission type on the Type Certificate Data Sheet.
Source_URL: https://www.ecfr.gov/current/title-14/chapter-I/subchapter-C/part-21/subpart-B/section-21.25
Status: Open
Verification_Method: Document Review

### 1.3 [FAA-21-003] Compliance with Applicable Airworthiness Requirements
Aircraft must meet the airworthiness requirements of an applicable category (Part 23 or Part 25) except those the FAA finds inappropriate for the special purpose operation.
Category: Certification
Part: Part 21
Regulation: Links the restricted certificate to the underlying airworthiness standard.
Source_URL: https://www.ecfr.gov/current/title-14/chapter-I/subchapter-C/part-21/subpart-B/section-21.25
Status: Open
Verification_Method: Analysis

### 1.4 [FAA-21-004] Noise Compliance
Applicant must show compliance with applicable noise requirements of 14 CFR Part 36.
Category: Noise/Emissions
Part: Part 21 / Part 36
Regulation: Required regardless of aircraft category or mission.
Source_URL: https://www.ecfr.gov/current/title-14/chapter-I/subchapter-C/part-21/subpart-B/section-21.25
Status: Open
Verification_Method: Test

### 1.5 [FAA-21-005] Instructions for Continued Airworthiness (ICA)
FAA-approved Instructions for Continued Airworthiness must be prepared for both the baseline aircraft and the firefighting (airtanker) mission configuration, meeting §25.1529 / §23.1529 as applicable at Amendment 54 or later.
Category: Certification
Part: Part 21 / Part 23 / Part 25
Regulation: ICAs are a prerequisite for airworthiness certificate issuance and continued operation.
Source_URL: https://www.ecfr.gov/current/title-14/chapter-I/subchapter-C/part-25/subpart-G/section-25.1529
Status: Open
Verification_Method: Document Review

### 1.6 [FAA-STR-001] Fatigue and Damage Tolerance Evaluation – Firefighting Mission
A fatigue and damage tolerance evaluation per §25.571 (Amdt. 25-54 or later) must identify loads, internal and external, to which principal structural elements (PSEs) are subjected in the firefighting role, and determine the impact of those loads on structural integrity.
Category: Airworthiness
Part: Part 25
Regulation: Water scooping and drop loads impose dynamic structural loads beyond standard flight envelope; separate evaluation required.
Source_URL: https://www.ecfr.gov/current/title-14/chapter-I/subchapter-C/part-25/subpart-C/section-25.571
Status: Open
Verification_Method: Analysis / Test

### 1.7 [FAA-STR-002] FAA Form 8110-3 – Fatigue Compliance Statement
Documentation must include an FAA Form 8110-3 (Statement of Compliance with FARs) specifying in the Purpose of Data block: 'Fatigue and Damage Tolerance evaluations for the aerial dispersion mission usage' and referencing §25.571 Amdt. 25-54 or later.
Category: Airworthiness
Part: Part 25
Regulation: Required for restricted category certification of firefighting aircraft per USFS Airworthiness Assurance Guide.
Source_URL: https://www.fs.usda.gov/sites/default/files/2020-12/fs_special_mission_airworthiness_assurance_guide_revision2_11_6_2015.pdf
Status: Open
Verification_Method: Document Review

### 1.8 [FAA-AMP-001] Hull Buoyancy Requirements
The hull must provide buoyancy 80% in excess of that required to support the maximum weight of the airplane in fresh water.
Category: Amphibious/Seaplane
Part: Part 23
Regulation: Ensures the aircraft remains afloat following a likely float or hull flooding event.
Source_URL: https://www.ecfr.gov/current/title-14/chapter-I/subchapter-C/part-23
Status: Open
Verification_Method: Analysis / Test

### 1.9 [FAA-AMP-002] Hull Stability – No Capsize in Calm Water
The aircraft must have sufficient margin to stay afloat at rest in calm water without capsizing in case of a likely float or hull flooding.
Category: Amphibious/Seaplane
Part: Part 23
Regulation: Directly relevant for water scooping operations where flooding risk is elevated.
Source_URL: https://www.ecfr.gov/current/title-14/chapter-I/subchapter-C/part-23
Status: Open
Verification_Method: Analysis / Test

### 1.10 [FAA-AMP-003] Hull and Main Float Load Factors
Structural load factors for the hull and main floats must be determined per §23.527 covering water landing conditions, step-turn, and planing conditions.
Category: Amphibious/Seaplane
Part: Part 23
Regulation: High-speed water scooping generates impulsive hydrodynamic loads requiring evaluation.
Source_URL: https://www.ecfr.gov/current/title-14/chapter-I/subchapter-C/part-23
Status: Open
Verification_Method: Analysis / Test

### 1.11 [FAA-AMP-004] Hull and Main Float Landing Conditions
Design must account for hull landing conditions per §23.529, including symmetrical step landing, symmetrical bow-and-stern landing, and unsymmetrical landing.
Category: Amphibious/Seaplane
Part: Part 23
Regulation: Repeated water landings during scooping operations create fatigue-critical loading.
Source_URL: https://www.ecfr.gov/current/title-14/chapter-I/subchapter-C/part-23
Status: Open
Verification_Method: Analysis / Test

### 1.12 [FAA-AMP-005] Hull Takeoff Condition
Design must address hull takeoff loads per §23.531 accounting for spray loads and hydrodynamic lift during water takeoff acceleration.
Category: Amphibious/Seaplane
Part: Part 23
Regulation: Particularly critical during loaded takeoff after scooping.
Source_URL: https://www.ecfr.gov/current/title-14/chapter-I/subchapter-C/part-23
Status: Open
Verification_Method: Analysis / Test

### 1.13 [FAA-AMP-006] Hull Bottom Pressures
Hull bottom pressure distribution must be determined per §23.533 for the design water load conditions.
Category: Amphibious/Seaplane
Part: Part 23
Regulation: Local bottom pressure governs hull skin and frame design.
Source_URL: https://www.ecfr.gov/current/title-14/chapter-I/subchapter-C/part-23
Status: Open
Verification_Method: Analysis

### 1.14 [FAA-AMP-007] Auxiliary Float Loads
Auxiliary float structural loads must be determined per §23.535.
Category: Amphibious/Seaplane
Part: Part 23
Regulation: Wingtip floats prevent capsize during low-speed water operations.
Source_URL: https://www.ecfr.gov/current/title-14/chapter-I/subchapter-C/part-23
Status: Open
Verification_Method: Analysis

### 1.15 [FAA-AMP-008] Seaplane Riding Lights
Riding lights must provide a white light visible in clear atmospheric conditions for seaplane/amphibian aircraft.
Category: Amphibious/Seaplane
Part: Part 23
Regulation: Required for water operations at night or reduced visibility.
Source_URL: https://www.ecfr.gov/current/title-14/chapter-I/subchapter-C/part-23
Status: Open
Verification_Method: Inspection

### 1.16 [FAA-AMP-009] Water Rudder / Directional Control on Water
Means for directional control while taxiing on water must be provided; water rudder systems must be shown adequate for all required water maneuvers.
Category: Amphibious/Seaplane
Part: Part 23
Regulation: Critical for safe maneuvering on confined or obstructed water bodies used as fire bases.
Source_URL: https://www.ecfr.gov/current/title-14/chapter-I/subchapter-C/part-23
Status: Open
Verification_Method: Test

### 1.17 [FAA-AMP-010] Seaplane Appendix I – Loads
All applicable seaplane load criteria in Appendix I to Part 23 must be addressed in the structural analysis.
Category: Amphibious/Seaplane
Part: Part 23
Regulation: Appendix I consolidates seaplane-specific load requirements.
Source_URL: https://www.ecfr.gov/current/title-14/chapter-I/subchapter-C/part-23
Status: Open
Verification_Method: Analysis

### 1.18 [FAA-PP-001] Engine Type Certificate – Turboprop
Each turboprop engine must be type certificated per 14 CFR Part 33 (Airworthiness Standards: Aircraft Engines).
Category: Powerplant
Part: Part 33
Regulation: Establishes the certified performance and reliability basis for the installed engines.
Source_URL: https://www.ecfr.gov/current/title-14/chapter-I/subchapter-C/part-33
Status: Open
Verification_Method: Document Review

### 1.19 [FAA-PP-002] Propeller Type Certificate
Each propeller must be type certificated per 14 CFR Part 35 (Airworthiness Standards: Propellers).
Category: Powerplant
Part: Part 35
Regulation: Turboprop propellers must be certified for the torque and overspeed envelope expected in the mission.
Source_URL: https://www.ecfr.gov/current/title-14/chapter-I/subchapter-C/part-35
Status: Open
Verification_Method: Document Review

### 1.20 [FAA-PP-003] Engine Installation – Turboprop Compliance
Turboprop installations must comply with Part 23 Subpart E powerplant requirements, including engine controls, fuel system, oil system, cooling, and fire protection.
Category: Powerplant
Part: Part 23
Regulation: Covers the full installed powerplant system beyond the certified engine itself.
Source_URL: https://www.ecfr.gov/current/title-14/chapter-I/subchapter-C/part-23
Status: Open
Verification_Method: Analysis / Inspection

### 1.21 [FAA-PP-004] Engine Cooling – Low-Speed / Scooping Flight Regime
Engine cooling must be shown adequate throughout the operating envelope including low-altitude, low-speed flight during water scooping and fire drop operations.
Category: Powerplant
Part: Part 23
Regulation: Cooling margins at low-speed/high-power conditions may be critical for this mission profile.
Source_URL: https://www.ecfr.gov/current/title-14/chapter-I/subchapter-C/part-23
Status: Open
Verification_Method: Test

### 1.22 [FAA-PP-005] Engine Fire Protection
Each engine must be isolated in a fire zone with firewall, drain provisions, and fire detection system. Turboprop installations require flammable fluid shut-off means.
Category: Powerplant
Part: Part 23
Regulation: Exposure to flame retardant chemicals during firefighting requires corrosion and seal compatibility review.
Source_URL: https://www.ecfr.gov/current/title-14/chapter-I/subchapter-C/part-23
Status: Open
Verification_Method: Inspection / Analysis

### 1.23 [FAA-PP-006] Propeller Clearance
Propeller clearance from ground and water must meet minimum clearance requirements per §23.925. Must account for amphibious operations and trim at scooping attitude.
Category: Powerplant
Part: Part 23
Regulation: Water spray ingestion and blade strike risk during water operations.
Source_URL: https://www.ecfr.gov/current/title-14/chapter-I/subchapter-C/part-23
Status: Open
Verification_Method: Analysis / Measurement

### 1.24 [FAA-PP-007] Engine Ice Protection
Engine induction system ice protection must be provided and demonstrated effective throughout the required flight envelope.
Category: Powerplant
Part: Part 23
Regulation: Required for operations at altitude and cold-weather fire seasons.
Source_URL: https://www.ecfr.gov/current/title-14/chapter-I/subchapter-C/part-23
Status: Open
Verification_Method: Test / Analysis

### 1.25 [FAA-PP-008] One Engine Inoperative (OEI) Performance
Aircraft must demonstrate climb performance with one engine inoperative at the appropriate certification level, including at the maximum scooping/dispensing weight.
Category: Airworthiness
Part: Part 23
Regulation: Critical safety requirement – loss of one engine during low-altitude scooping is a high-risk scenario.
Source_URL: https://www.ecfr.gov/current/title-14/chapter-I/subchapter-C/part-23
Status: Open
Verification_Method: Flight Test

### 1.26 [FAA-FF-001] Retardant/Water Tank System Design
The onboard water/retardant tank and dispensing system must be designed and installed as a certified modification (STC or TC change). System must not adversely affect flight characteristics, structural integrity, or any aircraft system.
Category: Firefighting
Part: Part 21
Regulation: The tank is the primary mission equipment; its structural and system integration requires formal FAA approval.
Source_URL: https://www.ecfr.gov/current/title-14/chapter-I/subchapter-C/part-21
Status: Open
Verification_Method: Analysis / Test

### 1.27 [FAA-FF-002] Drop Door / Dispensing System – Structural Loads
Structural loads imparted by the water/retardant dispensing system (fill, carry, drop) must be evaluated and shown not to exceed design limit loads for the airframe.
Category: Firefighting
Part: Part 23 / Part 25
Regulation: Rapid dump of large water mass causes significant transient dynamic loads on airframe.
Source_URL: https://www.ecfr.gov/current/title-14/chapter-I/subchapter-C/part-25/subpart-C/section-25.571
Status: Open
Verification_Method: Analysis / Test

### 1.28 [FAA-FF-003] Scooping System Intake – Hydrodynamic and Structural
The water intake scoop system must be structurally evaluated for hydrodynamic drag loads during scooping at approved scoop speeds and sea states.
Category: Firefighting
Part: Part 23 / Special Conditions
Regulation: Scoop deployment at speed creates combined aerodynamic and hydrodynamic loads unique to this aircraft type.
Source_URL: N/A – coordinate with FAA ACO for applicable special conditions
Status: Open
Verification_Method: Analysis / Test

### 1.29 [FAA-FF-004] Retardant Chemical Compatibility
All materials in the tank, dispensing system, and potentially exposed airframe areas must be shown compatible with fire retardant chemicals used in the mission (ammonium polyphosphate-based retardants and water).
Category: Firefighting
Part: Part 23
Regulation: Corrosion of aluminum structure or seals by retardant chemicals is a known aging aircraft concern.
Source_URL: https://www.fs.usda.gov/sites/default/files/2020-12/fs_special_mission_airworthiness_assurance_guide_revision2_11_6_2015.pdf
Status: Open
Verification_Method: Analysis / Inspection

### 1.30 [FAA-FF-005] Flight Manual Supplement – Firefighting Operations
An FAA-approved Airplane Flight Manual Supplement (AFMS) must be prepared covering the firefighting mission, including scooping speeds, drop speeds, system operating procedures, emergency procedures, and performance data.
Category: Firefighting
Part: Part 23
Regulation: Pilots must have approved procedures and performance data for the mission-specific envelope.
Source_URL: https://www.ecfr.gov/current/title-14/chapter-I/subchapter-C/part-23
Status: Open
Verification_Method: Document Review

### 1.31 [FAA-FF-006] Placards and Markings – Mission Equipment
All mission-specific controls (tank, scoop, drop doors) must be labeled with appropriate placards per §23.1555 and §23.1557.
Category: Firefighting
Part: Part 23
Regulation: Required to prevent inadvertent operation of mission systems during non-mission flight.
Source_URL: https://www.ecfr.gov/current/title-14/chapter-I/subchapter-C/part-23
Status: Open
Verification_Method: Inspection

### 1.32 [FAA-OPS-001] Airworthiness Certificate – Restricted Category
Aircraft must hold a current and valid restricted category airworthiness certificate issued per §21.183 / §21.185 and displayed per §91.203.
Category: Operations
Part: Part 91
Regulation: Base operating requirement for any civil aircraft operation.
Source_URL: https://www.ecfr.gov/current/title-14/chapter-I/subchapter-C/part-21
Status: Open
Verification_Method: Document Review

### 1.33 [FAA-OPS-002] Operational Limitations – Restricted Category
The aircraft must be operated in accordance with the limitations of its restricted category certificate. Operations over populated areas and in congested airways require FAA waiver per §91.313.
Category: Operations
Part: Part 91
Regulation: Restricted category aircraft have specific airspace and overflight limitations.
Source_URL: https://www.ecfr.gov/current/title-14/chapter-I/subchapter-C/part-91/subpart-D/section-91.313
Status: Open
Verification_Method: Document Review

### 1.34 [FAA-OPS-003] Annual / Periodic Inspection
Turbopropeller-powered multiengine airplanes must operate under an FAA-approved inspection program per §91.409(e), rather than a standard annual inspection.
Category: Operations
Part: Part 91
Regulation: Inspection program must address firefighting mission usage, including ICA from fatigue evaluation.
Source_URL: https://www.ecfr.gov/current/title-14/chapter-I/subchapter-C/part-91
Status: Open
Verification_Method: Document Review

### 1.35 [FAA-OPS-004] Fuel Venting and Exhaust Emissions
Aircraft must comply with fuel venting and exhaust emission requirements of 14 CFR Part 34.
Category: Noise/Emissions
Part: Part 34
Regulation: Required for all certificated aircraft regardless of category.
Source_URL: https://www.ecfr.gov/current/title-14/chapter-I/subchapter-C/part-34
Status: Open
Verification_Method: Analysis / Test

## 2 [#37]