# Requirement set FAR_Part25_Firefighting_Requirements (R2024a)

Attributes:
- Category: Imported from Excel:Category
- Regulation: Imported from Excel:Regulation
- Source_URL: Imported from Excel:Source_URL
- Status: Imported from Excel:Status
- Subpart: Imported from Excel:Subpart
- Verification_Method: Imported from Excel:Verification_Method

## 1 [FAR_Part25_Firefighting_Requirements!FAR_Part25_Requirements] References to FAR_Part25_Firefighting_Requirements.xlsx (FAR_Part25_Requirements) (Container)
Read-only references to Microsoft Excel document.

### 1.1 [P25-A-001] Applicability – Transport Category
Part 25 prescribes airworthiness standards for the issuance of type certificates and changes to those certificates for transport category airplanes. Applies to propeller-driven airplanes with MTOW > 19,000 lb or > 19 seats.
Category: Subpart A – General
Regulation: Establishes the scope and applicability of Part 25 to the aircraft.
Source_URL: https://www.ecfr.gov/current/title-14/chapter-I/subchapter-C/part-25/subpart-A/section-25.1
Status: Open
Subpart: Subpart A – General
Verification_Method: Document Review

### 1.2 [P25-B-001] Proof of Compliance – Flight
Each requirement of Subpart B must be met at each appropriate combination of airspeed and engine power covering the complete operational envelope, including the firefighting and water scooping configuration.
Category: Subpart B – Flight
Regulation: Defines the framework for demonstrating all flight performance and handling qualities requirements.
Source_URL: https://www.ecfr.gov/current/title-14/chapter-I/subchapter-C/part-25/subpart-B/section-25.21
Status: Open
Subpart: Subpart B – Flight
Verification_Method: Flight Test / Analysis

### 1.3 [P25-B-002] Weight and CG Limits
Maximum and minimum weights and center of gravity limits must be established for all configurations, including the water/retardant loaded condition (full tank), partially filled, and empty tank states.
Category: Subpart B – Flight
Regulation: Water/retardant loading significantly affects CG range; each loading state must be enveloped.
Source_URL: https://www.ecfr.gov/current/title-14/chapter-I/subchapter-C/part-25/subpart-B/section-25.25
Status: Open
Subpart: Subpart B – Flight
Verification_Method: Analysis / Flight Test

### 1.4 [P25-B-003] Propeller Speed and Pitch Limits
Propeller speed and pitch limits must be established for the turboprop installation that are not exceeded in any normal operation including the maximum power scooping and drop maneuvers.
Category: Subpart B – Flight
Regulation: Turboprop propeller operating limits must be defined and documented in the AFM.
Source_URL: https://www.ecfr.gov/current/title-14/chapter-I/subchapter-C/part-25/subpart-B/section-25.33
Status: Open
Subpart: Subpart B – Flight
Verification_Method: Analysis / Test

### 1.5 [P25-B-004] Stall Speed
The stall speed VS1 (flaps up) and VS0 (landing configuration) must be determined. These form the basis for all other speed scheduling requirements.
Category: Subpart B – Flight
Regulation: Stall speeds in firefighting configurations (tank full/empty, scoop deployed) must all be characterized.
Source_URL: https://www.ecfr.gov/current/title-14/chapter-I/subchapter-C/part-25/subpart-B/section-25.103
Status: Open
Subpart: Subpart B – Flight
Verification_Method: Flight Test

### 1.6 [P25-B-005] Takeoff Performance
Takeoff distance, takeoff run, and takeoff flight path must be determined at maximum takeoff weight, including water-laden (post-scoop) configuration, at the critical combinations of altitude and temperature.
Category: Subpart B – Flight
Regulation: Water scooping results in a fully loaded takeoff from water; performance must be demonstrated at max gross weight.
Source_URL: https://www.ecfr.gov/current/title-14/chapter-I/subchapter-C/part-25/subpart-B/section-25.105
Status: Open
Subpart: Subpart B – Flight
Verification_Method: Flight Test

### 1.7 [P25-B-006] Takeoff Speeds – V1, VR, V2
Decision speed V1, rotation speed VR, and takeoff safety speed V2 must be established for all takeoff configurations including the water-laden state post-scooping.
Category: Subpart B – Flight
Regulation: V-speeds must account for the unique water takeoff regime and loaded condition.
Source_URL: https://www.ecfr.gov/current/title-14/chapter-I/subchapter-C/part-25/subpart-B/section-25.107
Status: Open
Subpart: Subpart B – Flight
Verification_Method: Flight Test / Analysis

### 1.8 [P25-B-007] Accelerate-Stop Distance
Accelerate-stop distance must be determined for both land and water operations. The water accelerate-stop distance is particularly critical given limited water runway lengths at fire bases.
Category: Subpart B – Flight
Regulation: Rejected water takeoff is a high-risk scenario; stopping distance on water must be demonstrated.
Source_URL: https://www.ecfr.gov/current/title-14/chapter-I/subchapter-C/part-25/subpart-B/section-25.109
Status: Open
Subpart: Subpart B – Flight
Verification_Method: Flight Test

### 1.9 [P25-B-008] Climb: All-Engines-Operating
Climb gradient requirements must be met with all engines operating in the takeoff and en route configurations at the relevant weights including maximum water/retardant load.
Category: Subpart B – Flight
Regulation: Obstacle clearance after water takeoff from confined lakes/rivers is mission-critical.
Source_URL: https://www.ecfr.gov/current/title-14/chapter-I/subchapter-C/part-25/subpart-B/section-25.117
Status: Open
Subpart: Subpart B – Flight
Verification_Method: Flight Test

### 1.10 [P25-B-009] Climb: One-Engine-Inoperative (OEI)
The aircraft must meet OEI climb gradient requirements (§25.121) in all segments of flight. Net climb gradient with OEI in the final takeoff configuration must be ≥ 1.2% (twin turboprop, 2 engines). Critical scenario includes OEI during low-altitude scooping run.
Category: Subpart B – Flight
Regulation: OEI at low altitude over water during a scoop run is the most operationally demanding scenario.
Source_URL: https://www.ecfr.gov/current/title-14/chapter-I/subchapter-C/part-25/subpart-B/section-25.121
Status: Open
Subpart: Subpart B – Flight
Verification_Method: Flight Test

### 1.11 [P25-B-010] En Route Flight Paths – OEI
En route net flight path with one engine inoperative must clear all obstacles by 1,000 ft (IFR) or 2,000 ft (IFR mountainous) along the planned operational routes.
Category: Subpart B – Flight
Regulation: Relevant for transit legs to and from fire areas in mountainous terrain.
Source_URL: https://www.ecfr.gov/current/title-14/chapter-I/subchapter-C/part-25/subpart-B/section-25.123
Status: Open
Subpart: Subpart B – Flight
Verification_Method: Analysis / Flight Test

### 1.12 [P25-B-011] Landing Performance
Landing distance must be established for both land and water operations at the maximum landing weight. For water landings, the limiting conditions applicable to amphibious operations must be included.
Category: Subpart B – Flight
Regulation: Water landing performance must be demonstrated for both empty and fuel-only configurations.
Source_URL: https://www.ecfr.gov/current/title-14/chapter-I/subchapter-C/part-25/subpart-B/section-25.125
Status: Open
Subpart: Subpart B – Flight
Verification_Method: Flight Test

### 1.13 [P25-B-012] Controllability and Maneuverability – General
The airplane must be safely controllable and maneuverable during all stages of flight including takeoff, climb, cruise, descent, approach, and landing, in each configuration including water scoop deployed.
Category: Subpart B – Flight
Regulation: Scoop deployment creates significant aerodynamic drag and may affect pitch/directional trim.
Source_URL: https://www.ecfr.gov/current/title-14/chapter-I/subchapter-C/part-25/subpart-B/section-25.143
Status: Open
Subpart: Subpart B – Flight
Verification_Method: Flight Test

### 1.14 [P25-B-013] Longitudinal Control
It must be possible to pitch the nose down to recover from stall using primary controls at any speed, altitude, and configuration including full water/retardant load.
Category: Subpart B – Flight
Regulation: CG shift from tank loading/emptying must not compromise longitudinal control authority.
Source_URL: https://www.ecfr.gov/current/title-14/chapter-I/subchapter-C/part-25/subpart-B/section-25.145
Status: Open
Subpart: Subpart B – Flight
Verification_Method: Flight Test

### 1.15 [P25-B-014] Minimum Control Speeds – Vmca and Vmcg
Minimum control speed in the air (Vmca) and on the ground (Vmcg) must be determined for the turboprop configuration. Vmcl (landing) must also be demonstrated.
Category: Subpart B – Flight
Regulation: Twin turboprop asymmetric thrust at low speed (scooping altitude) must be safely manageable.
Source_URL: https://www.ecfr.gov/current/title-14/chapter-I/subchapter-C/part-25/subpart-B/section-25.149
Status: Open
Subpart: Subpart B – Flight
Verification_Method: Flight Test

### 1.16 [P25-B-015] Trim
The airplane must maintain level flight hands-off with the most critical combination of weight, altitude, speed, and power settings including post-drop (sudden CG shift) condition.
Category: Subpart B – Flight
Regulation: Rapid dump of large water mass causes sudden weight/CG change requiring trim characterization.
Source_URL: https://www.ecfr.gov/current/title-14/chapter-I/subchapter-C/part-25/subpart-B/section-25.161
Status: Open
Subpart: Subpart B – Flight
Verification_Method: Flight Test

### 1.17 [P25-B-016] Static Longitudinal, Lateral-Directional Stability
The aircraft must demonstrate positive static longitudinal stability (§25.173) and acceptable lateral-directional stability (§25.177) throughout the operational envelope including all loading states.
Category: Subpart B – Flight
Regulation: Stability characteristics must be acceptable in both full and empty water tank configurations.
Source_URL: https://www.ecfr.gov/current/title-14/chapter-I/subchapter-C/part-25/subpart-B/section-25.171
Status: Open
Subpart: Subpart B – Flight
Verification_Method: Flight Test

### 1.18 [P25-B-017] Dynamic Stability
Any short-period oscillation and phugoid mode must meet the dynamic stability criteria of §25.181 throughout the flight envelope.
Category: Subpart B – Flight
Regulation: Must be assessed with water tank loaded (heaviest) and empty (lightest) CG cases.
Source_URL: https://www.ecfr.gov/current/title-14/chapter-I/subchapter-C/part-25/subpart-B/section-25.181
Status: Open
Subpart: Subpart B – Flight
Verification_Method: Flight Test / Analysis

### 1.19 [P25-B-018] Stall Characteristics and Warning
The aircraft must demonstrate acceptable stall characteristics with adequate pre-stall warning (§25.207) in all configurations including scoop deployed and water tank full/empty.
Category: Subpart B – Flight
Regulation: Stall at low altitude over water is catastrophic; stall warning onset must be clearly defined.
Source_URL: https://www.ecfr.gov/current/title-14/chapter-I/subchapter-C/part-25/subpart-B/section-25.201
Status: Open
Subpart: Subpart B – Flight
Verification_Method: Flight Test

### 1.20 [P25-B-W01] Longitudinal Stability and Control on Water
The aircraft must demonstrate satisfactory longitudinal stability and control while on water, including during the water scooping acceleration/deceleration run.
Category: Subpart B – Seaplane/Water Ops
Regulation: Porpoising tendency during high-speed water run must be evaluated and shown absent or controllable.
Source_URL: https://www.ecfr.gov/current/title-14/chapter-I/subchapter-C/part-25/subpart-B/section-25.231
Status: Open
Subpart: Subpart B – Seaplane/Water Ops
Verification_Method: Flight Test

### 1.21 [P25-B-W02] Directional Stability and Control on Water
The aircraft must have satisfactory directional control during straight taxiing and step turns on water at all loading states and in all crosswind conditions up to the maximum demonstrated crosswind.
Category: Subpart B – Seaplane/Water Ops
Regulation: Directional control at fire-base lakes/rivers may be complicated by confined water areas and wind.
Source_URL: https://www.ecfr.gov/current/title-14/chapter-I/subchapter-C/part-25/subpart-B/section-25.233
Status: Open
Subpart: Subpart B – Seaplane/Water Ops
Verification_Method: Flight Test

### 1.22 [P25-B-W03] Taxiing Condition on Water
The aircraft must be controllable on water under expected sea state conditions. Taxiing ability in rough water must be evaluated.
Category: Subpart B – Seaplane/Water Ops
Regulation: Fire-base water bodies are often small with wake/chop from aircraft operations.
Source_URL: https://www.ecfr.gov/current/title-14/chapter-I/subchapter-C/part-25/subpart-B/section-25.235
Status: Open
Subpart: Subpart B – Seaplane/Water Ops
Verification_Method: Flight Test

### 1.23 [P25-B-W04] Wind Velocities for Water Operations
Maximum demonstrated crosswind and headwind/tailwind components for water takeoff and landing must be established and documented in the AFM.
Category: Subpart B – Seaplane/Water Ops
Regulation: Operational wind limits at fire-base water bodies must be defined for crew decision-making.
Source_URL: https://www.ecfr.gov/current/title-14/chapter-I/subchapter-C/part-25/subpart-B/section-25.237
Status: Open
Subpart: Subpart B – Seaplane/Water Ops
Verification_Method: Flight Test

### 1.24 [P25-B-W05] Spray Characteristics, Control, and Stability on Water
The spray generated during water operations (particularly high-speed scooping runs) must not impair pilot visibility or adversely affect propeller, engine inlet, control surfaces, or any other critical system.
Category: Subpart B – Seaplane/Water Ops
Regulation: Turboprop propeller and engine inlet vulnerability to water spray ingestion is critical during scooping.
Source_URL: https://www.ecfr.gov/current/title-14/chapter-I/subchapter-C/part-25/subpart-B/section-25.239
Status: Open
Subpart: Subpart B – Seaplane/Water Ops
Verification_Method: Flight Test

### 1.25 [P25-B-W06] Vibration and Buffeting
There must be no buffeting in any normal flight condition severe enough to interfere with control of the aircraft or to cause excessive fatigue. This must be evaluated with scoop deployed.
Category: Subpart B – Seaplane/Water Ops
Regulation: Scoop deployment creates local flow disturbances that could induce buffet on horizontal stabilizer or wing.
Source_URL: https://www.ecfr.gov/current/title-14/chapter-I/subchapter-C/part-25/subpart-B/section-25.251
Status: Open
Subpart: Subpart B – Seaplane/Water Ops
Verification_Method: Flight Test / Analysis

### 1.26 [P25-C-001] Loads – General
Structural loads must be determined for all critical combinations of weight, altitude, speed, and configuration. Must include mission-specific loads: water-laden takeoff, drop maneuver transients, and scoop deployment/retraction loads.
Category: Subpart C – Structure
Regulation: Firefighting mission introduces loads not present in the standard transport category envelope.
Source_URL: https://www.ecfr.gov/current/title-14/chapter-I/subchapter-C/part-25/subpart-C/section-25.301
Status: Open
Subpart: Subpart C – Structure
Verification_Method: Analysis

### 1.27 [P25-C-002] Factor of Safety
A factor of safety of 1.5 must be applied to all limit loads to determine ultimate loads. All structure must withstand ultimate loads without failure.
Category: Subpart C – Structure
Regulation: Fundamental structural safety requirement applicable to all structural elements.
Source_URL: https://www.ecfr.gov/current/title-14/chapter-I/subchapter-C/part-25/subpart-C/section-25.303
Status: Open
Subpart: Subpart C – Structure
Verification_Method: Analysis / Test

### 1.28 [P25-C-003] Strength and Deformation
The structure must be able to support limit loads without detrimental permanent deformation, and ultimate loads for at least 3 seconds without failure.
Category: Subpart C – Structure
Regulation: Applicable to hull, tank structure, and scoop attachment under full mission loads.
Source_URL: https://www.ecfr.gov/current/title-14/chapter-I/subchapter-C/part-25/subpart-C/section-25.305
Status: Open
Subpart: Subpart C – Structure
Verification_Method: Analysis / Test

### 1.29 [P25-C-004] Flight Maneuvering Envelope – V-n Diagram
The flight maneuvering envelope (V-n diagram) must be established encompassing all approved configurations including the water/retardant loaded and empty states.
Category: Subpart C – Structure
Regulation: V-n diagram defines the structural design envelope; must cover all mission loading states.
Source_URL: https://www.ecfr.gov/current/title-14/chapter-I/subchapter-C/part-25/subpart-C/section-25.333
Status: Open
Subpart: Subpart C – Structure
Verification_Method: Analysis

### 1.30 [P25-C-005] Gust and Turbulence Loads
The aircraft structure must withstand gust loads per §25.341 for discrete gusts and continuous turbulence. Low-altitude turbulence encountered during fire drops must be considered.
Category: Subpart C – Structure
Regulation: Low-altitude gust environment in mountainous terrain near fires is particularly severe.
Source_URL: https://www.ecfr.gov/current/title-14/chapter-I/subchapter-C/part-25/subpart-C/section-25.341
Status: Open
Subpart: Subpart C – Structure
Verification_Method: Analysis

### 1.31 [P25-C-006] Engine Torque Loads – Turboprop
Structural loads due to turboprop engine torque, including gyroscopic loads from propeller, must be accounted for in the engine mount and nacelle structure design.
Category: Subpart C – Structure
Regulation: Twin turboprop torque and gyroscopic loads from large-diameter propellers must be assessed.
Source_URL: https://www.ecfr.gov/current/title-14/chapter-I/subchapter-C/part-25/subpart-C/section-25.361
Status: Open
Subpart: Subpart C – Structure
Verification_Method: Analysis

### 1.32 [P25-C-007] Unsymmetrical Loads due to Engine Failure
The structure must withstand loads resulting from sudden failure of one turboprop engine, including torque reaction and propeller drag loads.
Category: Subpart C – Structure
Regulation: OEI during low-altitude scooping creates asymmetric loading; structural adequacy must be shown.
Source_URL: https://www.ecfr.gov/current/title-14/chapter-I/subchapter-C/part-25/subpart-C/section-25.367
Status: Open
Subpart: Subpart C – Structure
Verification_Method: Analysis

### 1.33 [P25-C-008] Landing Gear – Land Landing Load Conditions
Landing gear and supporting structure must withstand the critical land landing conditions at maximum landing weight per §25.473–§25.511.
Category: Subpart C – Structure
Regulation: Amphibious aircraft retractable gear must withstand land landings; gear-up water landings also applicable.
Source_URL: https://www.ecfr.gov/current/title-14/chapter-I/subchapter-C/part-25/subpart-C/section-25.471
Status: Open
Subpart: Subpart C – Structure
Verification_Method: Analysis / Test

### 1.34 [P25-C-W01] Seaplane Load Conditions – General
Structural loads for all water operations must be determined per §25.521–§25.537, covering the symmetric and unsymmetrical step landing, stern landing, bow landing, and planing conditions.
Category: Subpart C – Seaplane Loads
Regulation: Governs the complete set of seaplane structural design load cases for the hull and floats.
Source_URL: https://www.ecfr.gov/current/title-14/chapter-I/subchapter-C/part-25/subpart-C/section-25.521
Status: Open
Subpart: Subpart C – Seaplane Loads
Verification_Method: Analysis

### 1.35 [P25-C-W02] Hull and Main Float Load Factors
Water load factors for the hull must be determined per §25.527 for step, stern, and bow loading conditions at the design weights and CG positions.
Category: Subpart C – Seaplane Loads
Regulation: Load factors govern the sizing of hull frames, keel, and chine structure.
Source_URL: https://www.ecfr.gov/current/title-14/chapter-I/subchapter-C/part-25/subpart-C/section-25.527
Status: Open
Subpart: Subpart C – Seaplane Loads
Verification_Method: Analysis

### 1.36 [P25-C-W03] Hull and Main Float Landing Conditions
The hull must be designed for the step, bow, stern, and unsymmetrical landing conditions per §25.529. Each condition represents a critical load case for hull and fuselage structure.
Category: Subpart C – Seaplane Loads
Regulation: Repeated hard water landings during scooping operations are a fatigue-critical loading scenario.
Source_URL: https://www.ecfr.gov/current/title-14/chapter-I/subchapter-C/part-25/subpart-C/section-25.529
Status: Open
Subpart: Subpart C – Seaplane Loads
Verification_Method: Analysis / Test

### 1.37 [P25-C-W04] Hull and Main Float Takeoff Condition
The hull structure must withstand the hydrodynamic and aerodynamic loads occurring during the water takeoff run, including the unstick condition and spray loads.
Category: Subpart C – Seaplane Loads
Regulation: Maximum gross weight water takeoff post-scoop is the critical takeoff load case.
Source_URL: https://www.ecfr.gov/current/title-14/chapter-I/subchapter-C/part-25/subpart-C/section-25.531
Status: Open
Subpart: Subpart C – Seaplane Loads
Verification_Method: Analysis

### 1.38 [P25-C-W05] Hull and Main Float Bottom Pressures
Local hull bottom pressure distribution must be determined per §25.533 and applied to the hull plating and frame design.
Category: Subpart C – Seaplane Loads
Regulation: Hull bottom panels and stringers are sized by local pressure rather than global load factor.
Source_URL: https://www.ecfr.gov/current/title-14/chapter-I/subchapter-C/part-25/subpart-C/section-25.533
Status: Open
Subpart: Subpart C – Seaplane Loads
Verification_Method: Analysis

### 1.39 [P25-C-W06] Auxiliary Float Loads
Auxiliary float structural loads (wingtip floats) must be determined per §25.535 covering the water contact and spray conditions.
Category: Subpart C – Seaplane Loads
Regulation: Wingtip float attachments must withstand dynamic water contact loads during water operations.
Source_URL: https://www.ecfr.gov/current/title-14/chapter-I/subchapter-C/part-25/subpart-C/section-25.535
Status: Open
Subpart: Subpart C – Seaplane Loads
Verification_Method: Analysis

### 1.40 [P25-C-W07] Seawing Loads
If seawings (sponsons or stub wings) are used to provide buoyancy or spray suppression, their loads must be determined per §25.537.
Category: Subpart C – Seaplane Loads
Regulation: Applicable if the design uses sponsons to improve water stability or directional control.
Source_URL: https://www.ecfr.gov/current/title-14/chapter-I/subchapter-C/part-25/subpart-C/section-25.537
Status: Open
Subpart: Subpart C – Seaplane Loads
Verification_Method: Analysis

### 1.41 [P25-C-E01] Emergency Landing – General
The aircraft structure must provide occupant protection under emergency landing conditions per §25.561 (g = 9.0 forward, 1.5 sideward, 6.0 downward for crew, etc.).
Category: Subpart C – Structure
Regulation: Inertial loads from emergency landing conditions govern crew seat and restraint design.
Source_URL: https://www.ecfr.gov/current/title-14/chapter-I/subchapter-C/part-25/subpart-C/section-25.561
Status: Open
Subpart: Subpart C – Structure
Verification_Method: Analysis / Test

### 1.42 [P25-C-E02] Emergency Landing Dynamic Conditions
Seat and occupant restraint systems must meet the dynamic load requirements of §25.562 to protect occupants under emergency crash conditions.
Category: Subpart C – Structure
Regulation: Dynamic seat tests are required for all crew positions in the fire-fighting aircraft.
Source_URL: https://www.ecfr.gov/current/title-14/chapter-I/subchapter-C/part-25/subpart-C/section-25.562
Status: Open
Subpart: Subpart C – Structure
Verification_Method: Test

### 1.43 [P25-C-F01] Damage Tolerance and Fatigue Evaluation – Firefighting Mission
A damage tolerance evaluation per §25.571 (Amendment 25-54 or later) must be performed for all principal structural elements (PSEs). The evaluation must specifically address loads from the firefighting mission: scooping hydrodynamic loads, drop transients, and repeated water landings.
Category: Subpart C – Fatigue/Damage Tolerance
Regulation: Firefighting mission introduces cyclic loads far beyond normal transport operations; PSE fatigue lives may be significantly reduced.
Source_URL: https://www.ecfr.gov/current/title-14/chapter-I/subchapter-C/part-25/subpart-C/section-25.571
Status: Open
Subpart: Subpart C – Fatigue/Damage Tolerance
Verification_Method: Analysis / Inspection Program

### 1.44 [P25-C-F02] PSE Identification and Load Spectrum
All principal structural elements must be identified and mission load spectra must be developed encompassing the full firefighting mission profile including ferry, transit, scooping, fire drop, and water operations cycles.
Category: Subpart C – Fatigue/Damage Tolerance
Regulation: Mission load spectra are the foundation of the damage tolerance evaluation and inspection intervals.
Source_URL: https://rgl.faa.gov/Regulatory_and_Guidance_Library/rgAdvisoryCircular.nsf/0/14f8f9674aa42ff486257e5f005a02d5/$FILE/AC25.571-1D.pdf
Status: Open
Subpart: Subpart C – Fatigue/Damage Tolerance
Verification_Method: Analysis

### 1.45 [P25-C-F03] Lightning Protection – Structure
The aircraft structure must provide lightning protection per §25.581 to prevent ignition of fuel vapors or damage to flight-critical structure from direct or swept lightning strikes.
Category: Subpart C – Fatigue/Damage Tolerance
Regulation: Operations near active thunderstorms in wildfire environments increase lightning exposure.
Source_URL: https://www.ecfr.gov/current/title-14/chapter-I/subchapter-C/part-25/subpart-C/section-25.581
Status: Open
Subpart: Subpart C – Fatigue/Damage Tolerance
Verification_Method: Analysis / Test

### 1.46 [P25-D-001] Materials
All materials used in the type design must meet approved specifications. Corrosion resistance of hull, tank, and exposed structure must be demonstrated against water and retardant chemical exposure.
Category: Subpart D – Design & Construction
Regulation: Retardant chemical (ammonium polyphosphate) exposure is a unique material compatibility concern.
Source_URL: https://www.ecfr.gov/current/title-14/chapter-I/subchapter-C/part-25/subpart-D/section-25.603
Status: Open
Subpart: Subpart D – Design & Construction
Verification_Method: Analysis / Coupon Test

### 1.47 [P25-D-002] Fabrication Methods
All fabrication methods must be approved. Special attention required for hull joints, scoop attachment structure, and water/retardant tank construction.
Category: Subpart D – Design & Construction
Regulation: Hull and tank fabrication quality directly affects structural integrity and watertightness.
Source_URL: https://www.ecfr.gov/current/title-14/chapter-I/subchapter-C/part-25/subpart-D/section-25.605
Status: Open
Subpart: Subpart D – Design & Construction
Verification_Method: Inspection / Document Review

### 1.48 [P25-D-003] Aeroelastic Stability
The aircraft must be free from flutter, divergence, and control reversal at all speeds up to VD/MD throughout the operational envelope, including with scoop deployed and tank in all filling states.
Category: Subpart D – Design & Construction
Regulation: Scoop hardware and water tank mass affect aircraft flutter margins; analysis must cover all configurations.
Source_URL: https://www.ecfr.gov/current/title-14/chapter-I/subchapter-C/part-25/subpart-D/section-25.629
Status: Open
Subpart: Subpart D – Design & Construction
Verification_Method: Analysis / Ground Vibration Test

### 1.49 [P25-D-004] Bird Strike Damage
The windshield and forward-facing structure must be designed to withstand a bird strike of 4 lbs at the aircraft's maximum approach speed.
Category: Subpart D – Design & Construction
Regulation: Low-altitude operations in fire areas increase bird strike probability.
Source_URL: https://www.ecfr.gov/current/title-14/chapter-I/subchapter-C/part-25/subpart-D/section-25.631
Status: Open
Subpart: Subpart D – Design & Construction
Verification_Method: Analysis / Test

### 1.50 [P25-D-005] Flight Control Systems – General
All flight control systems must meet the requirements of §25.671–§25.703. Any mission system actuation (scoop, drop door) must not interfere with primary flight controls.
Category: Subpart D – Design & Construction
Regulation: Hydraulic/electrical systems shared between mission equipment and flight controls require independence analysis.
Source_URL: https://www.ecfr.gov/current/title-14/chapter-I/subchapter-C/part-25/subpart-D/section-25.671
Status: Open
Subpart: Subpart D – Design & Construction
Verification_Method: Analysis / Test

### 1.51 [P25-D-006] Landing Gear Retracting Mechanism
The landing gear retraction mechanism must function reliably and the gear must be capable of extension by alternate means. Water ingestion into gear bays during water operations must be evaluated.
Category: Subpart D – Design & Construction
Regulation: Retractable gear on amphibious aircraft must operate reliably after water immersion/spray.
Source_URL: https://www.ecfr.gov/current/title-14/chapter-I/subchapter-C/part-25/subpart-D/section-25.729
Status: Open
Subpart: Subpart D – Design & Construction
Verification_Method: Test / Analysis

### 1.52 [P25-D-H01] Main Float Buoyancy
If fitted with main floats, each must provide sufficient buoyancy per §25.751 with the required 80% excess buoyancy margin.
Category: Subpart D – Hull/Float/Amphibious
Regulation: Float buoyancy margin provides safety against flooding and structural damage to floats.
Source_URL: https://www.ecfr.gov/current/title-14/chapter-I/subchapter-C/part-25/subpart-D/section-25.751
Status: Open
Subpart: Subpart D – Hull/Float/Amphibious
Verification_Method: Analysis

### 1.53 [P25-D-H02] Main Float Design
Main floats must be designed per §25.753 to withstand the water loads defined in Subpart C and must provide the required buoyancy margin.
Category: Subpart D – Hull/Float/Amphibious
Regulation: Float structural design must be compatible with repeated water landings at maximum scooping frequency.
Source_URL: https://www.ecfr.gov/current/title-14/chapter-I/subchapter-C/part-25/subpart-D/section-25.753
Status: Open
Subpart: Subpart D – Hull/Float/Amphibious
Verification_Method: Analysis / Test

### 1.54 [P25-D-H03] Hull Design
The hull must be watertight, provide adequate buoyancy, and meet all the structural load requirements of §25.521–§25.537. The water scoop intake must be integrated without compromising hull watertightness.
Category: Subpart D – Hull/Float/Amphibious
Regulation: Hull integrity is foundational to safe amphibious operations; scoop opening is a potential ingress point.
Source_URL: https://www.ecfr.gov/current/title-14/chapter-I/subchapter-C/part-25/subpart-D/section-25.755
Status: Open
Subpart: Subpart D – Hull/Float/Amphibious
Verification_Method: Analysis / Test / Inspection

### 1.55 [P25-D-F01] Flammable Fluid Fire Protection
All flammable fluid lines, fittings, and components must be shielded or located to minimize fire risk. Drainage provisions must prevent accumulation of flammable fluids in any area. Retardant foam concentrate (if used) must be assessed for fire risk.
Category: Subpart D – Fire Protection
Regulation: Hydraulic fluid, fuel, and oil lines near hot sections require protection analysis.
Source_URL: https://www.ecfr.gov/current/title-14/chapter-I/subchapter-C/part-25/subpart-D/section-25.863
Status: Open
Subpart: Subpart D – Fire Protection
Verification_Method: Analysis / Inspection

### 1.56 [P25-D-F02] Fire Protection of Flight Controls and Engine Mounts
Flight control systems, engine mounts, and other flight structure in designated fire zones must be fire resistant or fireproof.
Category: Subpart D – Fire Protection
Regulation: Required for all transport category aircraft; specific attention to nacelle and firewall area.
Source_URL: https://www.ecfr.gov/current/title-14/chapter-I/subchapter-C/part-25/subpart-D/section-25.865
Status: Open
Subpart: Subpart D – Fire Protection
Verification_Method: Analysis / Inspection

### 1.57 [P25-E-001] Powerplant Installation – General
Each powerplant installation must meet the requirements of §25.901. All engine and propeller systems must be designed and installed so that no single failure or malfunction of any part will prevent continued safe flight and landing.
Category: Subpart E – Powerplant
Regulation: General safety standard for the complete installed powerplant system.
Source_URL: https://www.ecfr.gov/current/title-14/chapter-I/subchapter-C/part-25/subpart-E/section-25.901
Status: Open
Subpart: Subpart E – Powerplant
Verification_Method: Analysis / Test

### 1.58 [P25-E-002] Engine Installation – Turbine
Each turboprop engine installation must comply with §25.903 including engine restart capability in flight, precautions against engine failure, and isolation provisions.
Category: Subpart E – Powerplant
Regulation: In-flight restart capability is critical for OEI recovery during low-altitude fire operations.
Source_URL: https://www.ecfr.gov/current/title-14/chapter-I/subchapter-C/part-25/subpart-E/section-25.903
Status: Open
Subpart: Subpart E – Powerplant
Verification_Method: Analysis / Test

### 1.59 [P25-E-T01] Propellers – Turboprop
Each propeller installation must comply with §25.905, including certification per Part 35, and must meet all installation, clearance, and safety requirements.
Category: Subpart E – Turboprop Specific
Regulation: Propeller installation on amphibious aircraft requires specific attention to water spray ingestion and blade clearance.
Source_URL: https://www.ecfr.gov/current/title-14/chapter-I/subchapter-C/part-25/subpart-E/section-25.905
Status: Open
Subpart: Subpart E – Turboprop Specific
Verification_Method: Analysis / Test

### 1.60 [P25-E-T02] Propeller Vibration and Fatigue
Each propeller must be shown to be free from harmful vibration and to have adequate fatigue strength under all conditions throughout the approved operating range, including mission-specific load cycles.
Category: Subpart E – Turboprop Specific
Regulation: Turboprop propeller fatigue life must account for scooping and fire drop power transients.
Source_URL: https://www.ecfr.gov/current/title-14/chapter-I/subchapter-C/part-25/subpart-E/section-25.907
Status: Open
Subpart: Subpart E – Turboprop Specific
Verification_Method: Analysis / Test

### 1.61 [P25-E-T03] Propeller Clearance – Water Operations
Propeller tip clearance from the water surface during taxiing, takeoff run, and landing must be sufficient to prevent blade strike. Must be evaluated at the critical (most nose-down) attitude on water.
Category: Subpart E – Turboprop Specific
Regulation: Hull step attitude and wave encounter during scooping are the critical propeller clearance cases.
Source_URL: https://www.ecfr.gov/current/title-14/chapter-I/subchapter-C/part-25/subpart-E/section-25.925
Status: Open
Subpart: Subpart E – Turboprop Specific
Verification_Method: Analysis / Measurement

### 1.62 [P25-E-T04] Propeller De-Icing
Propeller de-icing system must be provided and shown effective for flight in icing conditions per §25.929.
Category: Subpart E – Turboprop Specific
Regulation: Required if certification for flight in icing conditions is sought; relevant for cold-weather fire seasons.
Source_URL: https://www.ecfr.gov/current/title-14/chapter-I/subchapter-C/part-25/subpart-E/section-25.929
Status: Open
Subpart: Subpart E – Turboprop Specific
Verification_Method: Analysis / Test

### 1.63 [P25-E-T05] Turbopropeller-Drag Limiting Systems
A turboprop drag-limiting system (propeller auto-feather or torque limiter) must be installed to limit propeller drag to within structural limits upon engine failure.
Category: Subpart E – Turboprop Specific
Regulation: Engine failure at low altitude over water without auto-feather could result in uncontrollable yaw.
Source_URL: https://www.ecfr.gov/current/title-14/chapter-I/subchapter-C/part-25/subpart-E/section-25.937
Status: Open
Subpart: Subpart E – Turboprop Specific
Verification_Method: Analysis / Test

### 1.64 [P25-E-T06] Turbine Engine Operating Characteristics
All operating characteristics of the turboprop engines must be evaluated to ensure there are no adverse characteristics, including stall, surge, flameout, or compressor instability, throughout the flight envelope including rapid throttle movements during scooping.
Category: Subpart E – Turboprop Specific
Regulation: Rapid power changes during scooping and fire drops must not cause engine instability.
Source_URL: https://www.ecfr.gov/current/title-14/chapter-I/subchapter-C/part-25/subpart-E/section-25.939
Status: Open
Subpart: Subpart E – Turboprop Specific
Verification_Method: Test

### 1.65 [P25-E-T07] Propeller Reversing Systems
If propeller reversing is installed for water braking (post-scoop deceleration), the reversing system must comply with §25.933, including prevention of unintended reversal and structural adequacy.
Category: Subpart E – Turboprop Specific
Regulation: Propeller reverse may be used to shorten the water run after scooping; system safety must be demonstrated.
Source_URL: https://www.ecfr.gov/current/title-14/chapter-I/subchapter-C/part-25/subpart-E/section-25.933
Status: Open
Subpart: Subpart E – Turboprop Specific
Verification_Method: Analysis / Test

### 1.66 [P25-E-T08] Inlet, Engine, and Exhaust Compatibility
Engine inlets must be free from unacceptable distortion throughout the operating envelope including water spray conditions during scooping. Exhaust systems must not create hazards.
Category: Subpart E – Turboprop Specific
Regulation: Water spray ingestion into turboprop inlets during scooping is a unique hazard requiring evaluation.
Source_URL: https://www.ecfr.gov/current/title-14/chapter-I/subchapter-C/part-25/subpart-E/section-25.941
Status: Open
Subpart: Subpart E – Turboprop Specific
Verification_Method: Analysis / Test

### 1.67 [P25-E-F01] Fuel System – General
The fuel system must meet §25.951–§25.973 requirements including independence, flow, hot-weather operation, and tank design. Tank installation must be evaluated for corrosion resistance to water/retardant exposure.
Category: Subpart E – Powerplant
Regulation: Fuel tanks adjacent to or near the retardant tank must be protected from chemical contamination.
Source_URL: https://www.ecfr.gov/current/title-14/chapter-I/subchapter-C/part-25/subpart-E/section-25.951
Status: Open
Subpart: Subpart E – Powerplant
Verification_Method: Analysis / Inspection

### 1.68 [P25-E-F02] Fuel System Lightning Protection
The fuel system must be protected against lightning-induced ignition sources per §25.954.
Category: Subpart E – Powerplant
Regulation: Low-altitude wildfire operations increase thunderstorm exposure; fuel system bonding is critical.
Source_URL: https://www.ecfr.gov/current/title-14/chapter-I/subchapter-C/part-25/subpart-E/section-25.954
Status: Open
Subpart: Subpart E – Powerplant
Verification_Method: Analysis / Test

### 1.69 [P25-E-O01] Engine Cooling
Engine cooling must be shown adequate under the most critical combination of conditions including maximum continuous power at minimum airspeed (scooping configuration). Cowl flap position and control must be evaluated.
Category: Subpart E – Powerplant
Regulation: Low-speed, high-power scooping run is the most thermally demanding operating condition.
Source_URL: https://www.ecfr.gov/current/title-14/chapter-I/subchapter-C/part-25/subpart-E/section-25.1041
Status: Open
Subpart: Subpart E – Powerplant
Verification_Method: Flight Test

### 1.70 [P25-E-O02] Induction System Ice Protection
Engine air induction system ice protection must be provided and demonstrated effective in the icing conditions defined in Appendix C to Part 25 (and Appendix O if SLD conditions are sought).
Category: Subpart E – Powerplant
Regulation: Ice protection is required for any certification in icing conditions; critical at altitude during transit.
Source_URL: https://www.ecfr.gov/current/title-14/chapter-I/subchapter-C/part-25/subpart-E/section-25.1093
Status: Open
Subpart: Subpart E – Powerplant
Verification_Method: Test / Analysis

### 1.71 [P25-E-FP01] Engine Fire Protection – Zones and Firewalls
Each engine must be enclosed in a designated fire zone with approved firewall, drainage, and fire-resistant materials per §25.1181–§25.1193.
Category: Subpart E – Powerplant
Regulation: Engine fire zones must be established and all materials within must meet fire resistance requirements.
Source_URL: https://www.ecfr.gov/current/title-14/chapter-I/subchapter-C/part-25/subpart-E/section-25.1181
Status: Open
Subpart: Subpart E – Powerplant
Verification_Method: Analysis / Inspection

### 1.72 [P25-E-FP02] Engine Fire Extinguishing System
Each engine fire zone must have a fire extinguishing system capable of extinguishing any fire that could occur, with at least two shots available per §25.1195–§25.1201.
Category: Subpart E – Powerplant
Regulation: Standard transport category requirement; two-shot capability required for twin-engine aircraft.
Source_URL: https://www.ecfr.gov/current/title-14/chapter-I/subchapter-C/part-25/subpart-E/section-25.1195
Status: Open
Subpart: Subpart E – Powerplant
Verification_Method: Test

### 1.73 [P25-E-FP03] Engine Fire Detection System
An approved fire detection system must be installed in each engine fire zone per §25.1203. The system must provide timely warning with minimum false alarms.
Category: Subpart E – Powerplant
Regulation: Fire detection is a mandatory safety feature; detector calibration must account for the retardant chemical environment.
Source_URL: https://www.ecfr.gov/current/title-14/chapter-I/subchapter-C/part-25/subpart-E/section-25.1203
Status: Open
Subpart: Subpart E – Powerplant
Verification_Method: Test

### 1.74 [P25-F-001] Function and Installation – Equipment General
All equipment and installations must function as intended under all operating conditions. Mission equipment (tank, scoop, drop doors) must not adversely affect any airworthiness-related aircraft system.
Category: Subpart F – Equipment
Regulation: Establishes the functional adequacy requirement for all installed equipment.
Source_URL: https://www.ecfr.gov/current/title-14/chapter-I/subchapter-C/part-25/subpart-F/section-25.1301
Status: Open
Subpart: Subpart F – Equipment
Verification_Method: Analysis / Test

### 1.75 [P25-F-002] Equipment Systems and Installations – Safety Analysis
Equipment, systems, and installations must be designed so that any single failure or probable combination of failures does not prevent continued safe flight and landing. This applies to the mission system (tank, scoop, doors) and any aircraft systems it interfaces with.
Category: Subpart F – Equipment
Regulation: §25.1309 is a key safety requirement; mission system integration must be included in the safety assessment.
Source_URL: https://www.ecfr.gov/current/title-14/chapter-I/subchapter-C/part-25/subpart-F/section-25.1309
Status: Open
Subpart: Subpart F – Equipment
Verification_Method: FHA / FMEA / FTA Analysis

### 1.76 [P25-F-003] Flight and Navigation Instruments
Required flight instruments must be installed per §25.1303, including all instruments needed for the approved operations (IFR if applicable) and any mission-specific instrumentation.
Category: Subpart F – Equipment
Regulation: Mission equipment status (tank level, scoop position, door status) must be displayed per §25.1301.
Source_URL: https://www.ecfr.gov/current/title-14/chapter-I/subchapter-C/part-25/subpart-F/section-25.1303
Status: Open
Subpart: Subpart F – Equipment
Verification_Method: Inspection

### 1.77 [P25-F-004] HIRF and Lightning Protection – Equipment
Electrical and electronic systems must be protected against High Intensity Radiated Fields (HIRF) per §25.1317 and lightning indirect effects per §25.1316.
Category: Subpart F – Equipment
Regulation: Mission avionics and control systems must be assessed for HIRF and lightning vulnerability.
Source_URL: https://www.ecfr.gov/current/title-14/chapter-I/subchapter-C/part-25/subpart-F/section-25.1316
Status: Open
Subpart: Subpart F – Equipment
Verification_Method: Analysis / Test

### 1.78 [P25-G-001] Airspeed Limitations
Maximum operating speed VMO, design maneuvering speed VA, flap extension speed VFE, landing gear speeds VLE/VLO, and all other speed limitations must be established.
Category: Subpart G – Operating Limits
Regulation: Speed limits must cover mission-specific speeds: maximum scoop speed, maximum drop speed, scoop deploy/retract speed.
Source_URL: https://www.ecfr.gov/current/title-14/chapter-I/subchapter-C/part-25/subpart-G/section-25.1503
Status: Open
Subpart: Subpart G – Operating Limits
Verification_Method: Flight Test / Analysis

### 1.79 [P25-G-002] Minimum Flight Crew
The minimum flight crew must be established based on workload analysis per §25.1523. Mission workload during scooping and fire drop must be included in the analysis.
Category: Subpart G – Operating Limits
Regulation: Scooping operations at low altitude require coordinated crew workload; minimum crew determination must include mission tasks.
Source_URL: https://www.ecfr.gov/current/title-14/chapter-I/subchapter-C/part-25/subpart-G/section-25.1523
Status: Open
Subpart: Subpart G – Operating Limits
Verification_Method: Analysis / Simulation

### 1.80 [P25-G-003] Instructions for Continued Airworthiness (ICA)
FAA-approved ICAs must be prepared per §25.1529 and Appendix H to Part 25 for the baseline aircraft and specifically for the firefighting mission configuration, incorporating inspection intervals from the fatigue/damage tolerance evaluation.
Category: Subpart G – Operating Limits
Regulation: ICAs must address mission-induced fatigue; inspection intervals derived from §25.571 evaluation.
Source_URL: https://www.ecfr.gov/current/title-14/chapter-I/subchapter-C/part-25/subpart-G/section-25.1529
Status: Open
Subpart: Subpart G – Operating Limits
Verification_Method: Document Review

### 1.81 [P25-G-004] Powerplant Limitations
All turboprop engine operating limitations must be established and approved per §25.1521, including all power ratings (takeoff, max continuous, cruise) and operational limits.
Category: Subpart G – Operating Limits
Regulation: Engine limits must reflect maximum power demands during water scooping and initial climb.
Source_URL: https://www.ecfr.gov/current/title-14/chapter-I/subchapter-C/part-25/subpart-G/section-25.1521
Status: Open
Subpart: Subpart G – Operating Limits
Verification_Method: Document Review / Analysis

### 1.82 [P25-G-005] Airplane Flight Manual
An FAA-approved AFM must be prepared per §25.1581–§25.1587 containing all required limitations, normal/abnormal/emergency procedures, and performance data. An AFMS covering the firefighting mission must be included.
Category: Subpart G – Operating Limits
Regulation: The AFM/AFMS is the primary operational document; mission procedures and performance are mandatory content.
Source_URL: https://www.ecfr.gov/current/title-14/chapter-I/subchapter-C/part-25/subpart-G/section-25.1581
Status: Open
Subpart: Subpart G – Operating Limits
Verification_Method: Document Review

### 1.83 [P25-H-001] EWIS – General Requirements
All electrical wiring interconnection systems (EWIS) must be designed, installed, and maintained per §25.1701–§25.1733. Mission system wiring must be segregated from flight-critical EWIS.
Category: Subpart H – EWIS
Regulation: Water and retardant chemical exposure to wiring in hull/tank areas requires special protection.
Source_URL: https://www.ecfr.gov/current/title-14/chapter-I/subchapter-C/part-25/subpart-H/section-25.1701
Status: Open
Subpart: Subpart H – EWIS
Verification_Method: Inspection / Analysis

### 1.84 [P25-H-002] EWIS – Fire Protection
All EWIS in designated fire zones must be fireproof or fire-resistant per §25.1713. Wiring routes must minimize fire risk.
Category: Subpart H – EWIS
Regulation: Engine bay and nacelle EWIS fire protection is mandatory.
Source_URL: https://www.ecfr.gov/current/title-14/chapter-I/subchapter-C/part-25/subpart-H/section-25.1713
Status: Open
Subpart: Subpart H – EWIS
Verification_Method: Inspection

### 1.85 [P25-H-003] EWIS – Bonding and Static Electricity
All EWIS must incorporate adequate electrical bonding and protection against static electricity per §25.1715.
Category: Subpart H – EWIS
Regulation: Static discharge during water scooping and retardant drop could ignite fuel vapors without proper bonding.
Source_URL: https://www.ecfr.gov/current/title-14/chapter-I/subchapter-C/part-25/subpart-H/section-25.1715
Status: Open
Subpart: Subpart H – EWIS
Verification_Method: Inspection / Test

### 1.86 [P25-H-004] EWIS – ICA
Instructions for Continued Airworthiness for the EWIS must be prepared per §25.1729.
Category: Subpart H – EWIS
Regulation: EWIS in the hull and tank areas must have specific inspection procedures given the corrosive environment.
Source_URL: https://www.ecfr.gov/current/title-14/chapter-I/subchapter-C/part-25/subpart-H/section-25.1729
Status: Open
Subpart: Subpart H – EWIS
Verification_Method: Document Review

### 1.87 [P25-FF-001] Water/Retardant Tank System – Design and Integration
The water/retardant tank must be designed, qualified, and installed as a certified modification. It must not adversely affect the structural integrity, flight characteristics, or any aircraft system. Tank fill, carry, and dump loads must be fully defined.
Category: Firefighting Mission
Regulation: The tank is the primary mission equipment. Its structural and system integration requires full certification compliance.
Source_URL: https://www.ecfr.gov/current/title-14/chapter-I/subchapter-C/part-25
Status: Open
Subpart: Firefighting Mission
Verification_Method: Analysis / Test

### 1.88 [P25-FF-002] Water Scoop System – Structural and Hydrodynamic Qualification
The water scoop must be structurally qualified for the combined aerodynamic and hydrodynamic loads during deployment at the maximum scoop speed. A special conditions issue paper is anticipated for this novel design feature.
Category: Firefighting Mission
Regulation: No prescriptive FAR governs water scoop loads; FAA Special Conditions under §21.16 are expected.
Source_URL: https://www.ecfr.gov/current/title-14/chapter-I/subchapter-C/part-21/subpart-A/section-21.16
Status: Open
Subpart: Firefighting Mission
Verification_Method: Analysis / Test / Special Conditions

### 1.89 [P25-FF-003] Drop Door / Dispensing System – Loads and Structural Integrity
Drop door actuators, hinges, and the surrounding airframe structure must withstand the aerodynamic and inertial loads during door operation at all approved drop speeds and altitudes.
Category: Firefighting Mission
Regulation: Rapid opening of large drop doors at speed generates significant aerodynamic loads on door structure and fuselage.
Source_URL: https://www.ecfr.gov/current/title-14/chapter-I/subchapter-C/part-25
Status: Open
Subpart: Firefighting Mission
Verification_Method: Analysis / Test

### 1.90 [P25-FF-004] Retardant Chemical Compatibility – Airframe and Systems
All materials exposed to fire retardant chemicals (ammonium polyphosphate, water, foam additives) must be evaluated for compatibility. This includes hull plating, seals, hoses, electrical connectors, and any co-located aircraft systems.
Category: Firefighting Mission
Regulation: Long-term retardant exposure causes accelerated corrosion and seal degradation; regular inspection program required.
Source_URL: https://www.ecfr.gov/current/title-14/chapter-I/subchapter-C/part-25
Status: Open
Subpart: Firefighting Mission
Verification_Method: Analysis / Materials Test

### 1.91 [P25-FF-005] Flight Manual Supplement – Firefighting Operations
An FAA-approved AFMS must cover: approved scooping speeds, maximum drop speed, tank fill procedures, drop procedures, abort criteria, emergency jettison, water taxi procedures, and all mission-specific performance data.
Category: Firefighting Mission
Regulation: The AFMS is the primary reference for flight crew operating the aircraft in the firefighting role.
Source_URL: https://www.ecfr.gov/current/title-14/chapter-I/subchapter-C/part-25/subpart-G/section-25.1581
Status: Open
Subpart: Firefighting Mission
Verification_Method: Document Review

### 1.92 [P25-FF-006] Mission-Specific Placards and Markings
All mission-specific controls and equipment (water tank gauges, scoop control, drop door control, jettison) must have clear and approved placards per §25.1541–§25.1557.
Category: Firefighting Mission
Regulation: Cockpit workload during scooping is high; clear control labeling is a safety requirement.
Source_URL: https://www.ecfr.gov/current/title-14/chapter-I/subchapter-C/part-25/subpart-G/section-25.1541
Status: Open
Subpart: Firefighting Mission
Verification_Method: Inspection

### 1.93 [P25-FF-007] Emergency Jettison System
A means to jettison the water/retardant load in an emergency must be provided if carried. The jettison system must be operable by the flight crew without requiring unusual skill or strength, and operation must not endanger the aircraft or endanger persons on the ground.
Category: Firefighting Mission
Regulation: Emergency jettison protects the aircraft structural envelope in the event of inadvertent overweight condition or emergency descent requirement.
Source_URL: https://www.ecfr.gov/current/title-14/chapter-I/subchapter-C/part-25
Status: Open
Subpart: Firefighting Mission
Verification_Method: Analysis / Test